# Grasshopper definition dev_easing.ghx (Grasshopper 1.0.7)

pt = Point(Point(1.166421493, 1.081629097, 0))
pt_2 = Point(Point(6.702221689, 4.594021148, 0))
pt_3 = Point(Point(9.968189754, 2.719215775, 0))
merge = Merge(Data1=pt, Data2=pt_2, Data3=pt_3)
python = GhPythonScript(POINTS=merge)  # -> LINER, CUBIC, QUADRATIC, QUINTIC, SINE, CIRCULAR, EXPONENTIAL, ELASTIC, BACK, BOUNCE; inputs POINTS: list
# ---------- python: Python ----------
import sys
sys.path.append("C:\\Users\\ysoky\\Documents\\GH_Easing")
#print(sys.path)


import rhinoscriptsyntax as rs


from gh_easing import easing_geometry
reload(easing_geometry)

eg = easing_geometry.Easing_Geometry()

rr = 100


LINER = eg.easing_pts(POINTS, "LINER", rr)
CUBIC = eg.easing_pts(POINTS, "CUBIC", rr)
QUADRATIC = eg.easing_pts(POINTS, "QUADRATIC", rr)
QUINTIC = eg.easing_pts(POINTS, "QUINTIC", rr)
SINE = eg.easing_pts(POINTS, "SINE", rr)
CIRCULAR = eg.easing_pts(POINTS, "CIRCULAR", rr)
EXPONENTIAL = eg.easing_pts(POINTS, "EXPONENTIAL", rr)
ELASTIC = eg.easing_pts(POINTS, "ELASTIC", rr)
BACK = eg.easing_pts(POINTS, "BACK", rr)
BOUNCE = eg.easing_pts(POINTS, "BOUNCE", rr)
# ---------- end python ----------
crv = Curve(python.QUADRATIC)
